# Grasshopper definition solarAnalysis.gh (Grasshopper 1.0.7)
# plug-ins: BH.UI.Grasshopper

location = Location(
    Latitude=Slider(47, range=0..100),
    Longitude=Slider(30, range=0..100),
    Elevation=0,
    UtcOffset=Slider(2, range=0..10),
    Name="Kyiv",
    Component="BH.oM.Environment.Climate.Location")
createobject = CreateObject(Component="{ \"SelectedItem\" : null, \"InputParams\" : [], \"OutputParams\" : [], \"BHoM_Guid\" : \"8d7352cf-3caf-4690-a610-b079db08da24\" }")
spacetime = SpaceTime(
    Location=location,
    Year=Slider(2020, range=0..10000),
    Month=Slider(3, range=0..10),
    Day=Slider(21, range=0..100),
    Hour=Slider(12, range=0..100),
    Component="BH.oM.Environment.Climate.SpaceTime")
solarposition = SolarPosition(SpaceTime=spacetime, Component="{ .SolarPosition")
solarvector = SolarVector(Sun=solarposition, Component="{ .SolarVector")
line = LineSDL(Start="0,0,0", Direction=solarvector, Length=Slider(500, range=0..1000))
explode = Explode(Object=solarposition, Component="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")  # -> Azimuth, Altitude, BHoM_Guid, Name, Fragments, Tags, CustomData
getproperty = GetProperty(Obj=solarposition, PropName="Azimuth", Component="{ .GetProperty")
panel = Panel(solarvector)
